# Grasshopper definition solution_viewer.ghx (Grasshopper 1.0.7)

load = BooleanToggle(True)
connect = BooleanToggle(True)
ros = ROSConnect(connect=connect)  # -> ros_client, is_connected; inputs port: Int32, connect: Boolean
#   port ip: The ip address ROS. Defaults to 127.0.0.1.
#   port port: The port of ROS. Defaults to 9090.
#   port connect: If True, connects to ROS. If False, disconnects from ROS. Defaults to False.
#   port ros_client: The ROS client.
#   port is_connected: True if connection established.
# ---------- ros: Python ----------
"""
Connect or disconnect to ROS.

COMPAS FAB v0.22.0
"""
from ghpythonlib.componentbase import executingcomponent as component
from scriptcontext import sticky as st

from compas_fab.backends import RosClient
from compas_fab.ghpython.components import create_id


class ROSConnect(component):
    def RunScript(self, ip, port, connect):
        ros_client = None

        ip = ip or '127.0.0.1'
        port = port or 9090

        key = create_id(self, 'ros_client')
        ros_client = st.get(key, None)

        if ros_client:
            st[key].close()
        if connect:
            st[key] = RosClient(ip, port)
            st[key].run(5)

        ros_client = st.get(key, None)
        is_connected = ros_client.is_connected if ros_client else False
        return (ros_client, is_connected)
# ---------- end ros ----------
robot = ROSRobot(ros_client=ros.ros_client, load=load)  # -> robot; inputs load: Boolean
#   port ros_client: The ROS client.
#   port load: If True, loads the robot from ROS. Defaults to False.
# ---------- robot: Python ----------
"""
Load robot directly from ROS.

COMPAS FAB v0.22.0
"""
from compas_ghpython.artists import RobotModelArtist
from ghpythonlib.componentbase import executingcomponent as component
from scriptcontext import sticky as st

from compas_fab.ghpython.components import create_id


class ROSRobot(component):
    def RunScript(self, ros_client, load):
        key = create_id(self, 'robot')

        if ros_client and ros_client.is_connected and load:
            # Load URDF from ROS
            st[key] = ros_client.load_robot(load_geometry=True, precision='12f')
            st[key].artist = RobotModelArtist(st[key].model)

        robot = st.get(key, None)
        if robot:  # client sometimes need to be restarted, without needing to reload geometry
            robot.client = ros_client
        return robot
# ---------- end robot ----------

python = GhPythonScript(robot=robot)  # -> configuration; inputs frames: list
# ---------- python: Python ----------
# NOTE: Don't write you solution here!
# Write the code in the assignment_03.py and if
# the file is located in the same folder as this GH file
# then Grasshopper will find it and import it
from compas_ghpython import unload_modules
from compas.geometry import Frame, Point, Vector
unload_modules('assignment_03')

try:
    from assignment_03 import calculate_ik_for_frames
except ImportError:
    raise Exception("Please make sure you have the file assignment_03.py in the same location as this GH file")

from compas_fab.ghpython.components import coerce_frame

frames = [
    Frame(Point(-0.329, 0.059, 0.082), Vector(1.000, 0.000, 0.000), Vector(0.000, -1.000, 0.000)),
    Frame(Point(-0.260, 0.129, 0.082), Vector(1.000, 0.000, 0.000), Vector(0.000, -1.000, 0.100)),
    Frame(Point(-0.186, 0.194, 0.082), Vector(1.000, 0.000, 0.000), Vector(0.000, -1.000, 0.200)),
    Frame(Point(-0.106, 0.252, 0.082), Vector(1.000, 0.000, 0.000), Vector(0.000, -1.000, 0.300)),
    Frame(Point(-0.020, 0.299, 0.082), Vector(1.000, 0.000, 0.000), Vector(0.000, -1.000, 0.400)),
    Frame(Point(0.074, 0.329, 0.082), Vector(1.000, 0.000, 0.000), Vector(0.000, -1.000, 0.500)),
    Frame(Point(0.172, 0.330, 0.082), Vector(1.000, 0.000, 0.000), Vector(0.000, -1.000, 0.400)),
    Frame(Point(0.263, 0.295, 0.082), Vector(1.000, 0.000, 0.000), Vector(0.000, -1.000, 0.300)),
    Frame(Point(0.339, 0.233, 0.082), Vector(1.000, 0.000, 0.000), Vector(0.000, -1.000, 0.200)),
    Frame(Point(0.400, 0.155, 0.082), Vector(1.000, 0.000, 0.000), Vector(0.000, -1.000, 0.100)),
    Frame(Point(0.448, 0.070, 0.082), Vector(1.000, 0.000, 0.000), Vector(0.000, -1.000, 0.000))]
    
configuration = calculate_ik_for_frames(robot, frames)
# ---------- end python ----------
item = ListItem(List=python, Index=Slider(0, range=0..10), Wrap=True)

data = Data([Plane(origin=(-0.328996062, 0.05899978632, 0.08200253908), x=(1, -1.522059835e-07, 8.9183218e-07), y=(-1.522046811e-07, -1, -1.460366717e-06)), Plane(origin=(-0.2599991753, 0.1289990637, 0.0819999384), x=(1, -2.596233325e-07, -3.448317378e-06), y=(8.478521793e-08, -0.9950371993, 0.09950362855)), Plane(origin=(-0.1859977207, 0.1939971665, 0.08200008227), x=(1, -2.051878161e-06, -8.451903138e-06), y=(-3.544661893e-07, -0.9805804205, 0.1961174109)), Plane(origin=(-0.1059997719, 0.2519990391, 0.08199998623), x=(1, -5.16465691e-07, -2.086521297e-06), y=(1.048749666e-07, -0.9578260312, 0.2873487324)), Plane(origin=(-0.01999966564, 0.2989997265, 0.08200041617), x=(1, -2.275126914e-09, -5.140029009e-07), y=(1.887836533e-07, -0.9284765583, 0.3713910077)), Plane(origin=(0.07400035791, 0.3289995128, 0.0820003156), x=(1, 1.24901741e-07, -7.850448412e-07), y=(4.627986646e-07, -0.8944268968, 0.4472141839))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])
python_2 = GhPythonScript(x=[Slider(0.15, range=-3.14..3.14), Slider(-2.01, range=-3.14..3.14), Slider(-1.8, range=-3.14..3.14), Slider(-0.97, range=-3.14..3.14), Slider(1.55, range=-3.14..3.14), Slider(-0.41, range=-3.14..3.14)])  # -> out, config; inputs x: list
# ---------- python_2: Python ----------
from compas_fab.robots import Configuration

config = Configuration.from_revolute_values(x)
# ---------- end python_2 ----------
robot_visualize = RobotVisualize(robot=robot, configuration=item, show_end_effector_frame=Toggle(True))  # -> visual, collision, attached_meshes, frames, base_frame, ee_frame; inputs attached_collision_meshes: list, show_visual: Boolean, show_collision: Boolean, show_frames: Boolean, show_base_frame: Boolean, show_end_effector_frame: Boolean, show_acm: Boolean
#   port group: The planning group used for end-effector and base visualization.
#   port configuration: The robot's full configuration.
#   port attached_collision_meshes: A list of attached collision meshes.
#   port show_visual: Whether or not to show the robot's visual meshes.
#   port show_collision: Whether or not to show the robot's collision meshes.
#   port show_frames: Whether or not to show the robot's joint frames.
#   port show_base_frame: Whether or not to show the robot's base frame.
#   port show_end_effector_frame: Whether or not to show the robot's end-effector frame.
#   port show_acm: Whether or not to show the attached collision meshes (if any).
#   port visual: The robot's visual Rhino meshes (if any).
#   port collision: The robot's collision Rhino meshes (if any).
#   port attached_meshes: The attached collision Rhino meshes (if any).
#   port frames: The robot's joint frames as Rhino planes (if any).
#   port base_frame: The robot's base frame as a Rhino plane (if any).
#   port ee_frame: The robot's end-effector frame as a Rhino plane (if any).
# ---------- robot_visualize: Python ----------
"""
Visualizes the robot.

COMPAS FAB v0.22.0
"""
from compas.geometry import Frame
from compas.geometry import Transformation
from compas_ghpython.artists import FrameArtist
from compas_ghpython.artists import MeshArtist
from ghpythonlib.componentbase import executingcomponent as component


class RobotVisualize(component):
    def RunScript(self, robot, group, configuration, attached_collision_meshes, show_visual, show_collision,
                  show_frames, show_base_frame, show_end_effector_frame, show_acm):

        visual = None
        collision = None
        attached_meshes = None
        frames = None
        base_frame = None
        ee_frame = None

        if robot:
            show_visual = True if show_visual is None else show_visual
            configuration = configuration or robot.zero_configuration()

            robot.update(configuration, visual=show_visual, collision=show_collision)
            compas_frames = robot.transformed_frames(configuration, group)

            if show_visual:
                visual = robot.artist.draw_visual()

            if show_collision:
                collision = robot.artist.draw_collision()

            if show_base_frame:
                base_compas_frame = compas_frames[0]
                artist = FrameArtist(base_compas_frame)
                base_frame = artist.draw()

            if show_end_effector_frame:
                ee_compas_frame = robot.forward_kinematics(configuration, group, options=dict(solver='model'))
                artist = FrameArtist(ee_compas_frame)
                ee_frame = artist.draw()

            if show_frames:
                frames = []
                for compas_frame in compas_frames[1:]:
                    artist = FrameArtist(compas_frame)
                    frame = artist.draw()
                    frames.append(frame)

            if show_acm:
                attached_meshes = []
                for acm in attached_collision_meshes:
                    frame = robot.forward_kinematics(configuration, options=dict(solver='model', link_name=acm.link_name))
                    T = Transformation.from_frame_to_frame(Frame.worldXY(), frame)
                    mesh = acm.collision_mesh.mesh.transformed(T)
                    attached_meshes.append(MeshArtist(mesh).draw())

        return (visual, collision, attached_meshes, frames, base_frame, ee_frame)
# ---------- end robot_visualize ----------
